# Grasshopper definition RebarGroups.gh (Grasshopper 1.0.7)
# plug-ins: T-Rex

number_slider = Slider(500, range=0..1000)
pt = ConstructPoint(XCoordinate=Slider(500, range=0..1000), YCoordinate=0, ZCoordinate=0)
pt_2 = ConstructPoint(XCoordinate=number_slider, YCoordinate=number_slider, ZCoordinate=0)
pt_3 = ConstructPoint(XCoordinate=0, YCoordinate=Slider(500, range=0..1000), ZCoordinate=0)
pt_4 = ConstructPoint(XCoordinate=0, YCoordinate=0, ZCoordinate=0)
pt_5 = ConstructPoint(XCoordinate=0, YCoordinate=0, ZCoordinate=0)
pt_6 = ConstructPoint(XCoordinate=0, YCoordinate=0, ZCoordinate=0)
division = Division(A=Slider(7850, range=0..10000), B="1e9")
ln = Line(StartPoint=pt_4, EndPoint=pt)
ln_2 = Line(StartPoint=pt_5, EndPoint=pt_2)
ln_3 = Line(StartPoint=pt_6, EndPoint=pt_3)
material = Material(Name="Name of the material", Grade="Grade of the material", Density=division)
division_2 = Division(A=Slider(7850, range=0..10000), B="1e9")
division_3 = Division(A=Slider(7850, range=0..10000), B="1e9")
division_4 = Division(A=Slider(7850, range=0..10000), B="1e9")
material_2 = Material(Name="Name of the material", Grade="Grade of the material", Density=division_2)
material_3 = Material(Name="Name of the material", Grade="Grade of the material", Density=division_3)
pt_7 = ConstructPoint(XCoordinate=0, YCoordinate=0, ZCoordinate=0)
pt_8 = ConstructPoint(XCoordinate=Slider(500, range=0..1000), YCoordinate=0, ZCoordinate=0)
material_4 = Material(Name="Name of the material", Grade="Grade of the material", Density=division_4)
rebar_properties = RebarProperties(Diameter="20", Material=material)
vec = VectorXYZ(XComponent=Slider(3647, range=0..10000), YComponent=Slider(1268, range=0..10000), ZComponent=Slider(248, range=0..10000))  # -> Vector, Length
pt_9 = ConstructPoint(XCoordinate=0, YCoordinate=0, ZCoordinate=0)
pt_10 = ConstructPoint(XCoordinate=0, YCoordinate=0, ZCoordinate=0)
pt_11 = ConstructPoint(XCoordinate=Slider(500, range=0..1000), YCoordinate=0, ZCoordinate=0)
pt_12 = ConstructPoint(XCoordinate=Slider(500, range=0..1000), YCoordinate=0, ZCoordinate=0)
ln_4 = Line(StartPoint=pt_7, EndPoint=pt_8)
rebar_properties_2 = RebarProperties(Diameter="16", Material=material_2)
move = Move(Geometry=[ln, ln_2, ln_3], Motion=vec.Vector)  # -> Geometry, Transform
rebar_properties_3 = RebarProperties(Diameter="12", Material=material_3)
ln_5 = Line(StartPoint=pt_9, EndPoint=pt_11)
ln_6 = Line(StartPoint=pt_10, EndPoint=pt_12)
rebar_properties_4 = RebarProperties(Diameter="12", Material=material_4)
X = UnitX(Factor=Slider(1000, range=0..1000))
curve_to_rebar_shape = CurveToRebarShape(Curve=ln_4, Properties=rebar_properties)  # -> RebarShape, Mesh
move_2 = Move(Geometry=ln_5, Motion=X)  # -> Geometry, Transform
curve_to_rebar_shape_2 = CurveToRebarShape(Curve=move_2.Geometry, Properties=rebar_properties_2)  # -> RebarShape, Mesh
curve_to_rebar_shape_3 = CurveToRebarShape(Curve=ln_6, Properties=rebar_properties_3)  # -> RebarShape, Mesh
vec_2 = VectorXYZ(XComponent=0, YComponent=Slider(1000, range=0..1000), ZComponent=0)  # -> Vector, Length
curve_to_rebar_shape_4 = CurveToRebarShape(Curve=move.Geometry, Properties=rebar_properties_4)  # -> RebarShape, Mesh
vec_3 = VectorXYZ(XComponent=0, YComponent=Slider(1000, range=0..1000), ZComponent=0)  # -> Vector, Length
nurbs = NurbsCurve(
    Vertices=[Point(2666.108301, -26.32553221, 0), Point(3168.802054, 260.3974601, 0), Point(3217.929721, 798.5076921, 0), Point(3016.364568, 1175.544284, 0), Point(2508.957547, 1503.262923, 0), Point(2123.949713, 1399.383982, 0), Point(2066.983537, 1015.884306, 0), Point(1829.779858, 0, 697.8350593), Point(2193.726753, 0, 1041.562683), Point(2896.346455, 0, 1228.590949)],
    Degree=3,
    Periodic=False)  # -> Curve, Length, Domain
vector_count_spacing = VectorCountSpacing(Id="0", RebarShape=curve_to_rebar_shape_3.RebarShape, Vector=vec_3.Vector, Count=Slider(10, range=0..100))  # -> RebarGroup, Mesh, Curve
vector_length_spacing = VectorLengthSpacing(
    Id="0",
    RebarShape=curve_to_rebar_shape_2.RebarShape,
    Vector=vec_2.Vector,
    SpacingLength=Slider(100, range=0..1000),
    Type="0",
    Tolerance="0.0001")  # -> RebarGroup, Mesh, Curve
curve_spacing = CurveSpacing(
    Id="0",
    RebarShape=curve_to_rebar_shape.RebarShape,
    Curve=nurbs.Curve,
    Count=Slider(10, range=0..100),
    RotationAngle=degrees(Slider(90, range=0..360)))  # -> RebarGroup, Mesh, Curve
custom_spacing = CustomSpacing(Id="0", RebarShapes=curve_to_rebar_shape_4.RebarShape)  # -> RebarGroup, Mesh, Curve
path = FilePath("C:\Users\pc\RiderProjects\T-Rex\TestsInsideGrasshopper\IFCAndDotbimTests\IFCFiles\RebarGroups.ifc")
path_2 = FilePath("C:\Users\pc\RiderProjects\T-Rex\TestsInsideGrasshopper\IFCAndDotbimTests\IFCFiles\RebarGroups.bim")
create_ifc = CreateIFC(
    Groups=[vector_count_spacing.RebarGroup, vector_length_spacing.RebarGroup, curve_spacing.RebarGroup, custom_spacing.RebarGroup],
    ProjectName="RebarGroups Testing",
    BuildingName="Building Name",
    Path=path)
create_dotbim = CreateDotbim(
    Groups=[vector_count_spacing.RebarGroup, vector_length_spacing.RebarGroup, curve_spacing.RebarGroup, custom_spacing.RebarGroup],
    ProjectName="RebarGroups Testing",
    BuildingName="Building Name",
    GeometryScaleFactor=Slider(0.001, range=0..0.001),
    Path=path_2)
